# Grasshopper definition Export.gh (Grasshopper 0.9.64)
# plug-ins: gHowl, LunchBox

number_slider = Slider(45, range=0..500)
number_slider_2 = Slider(50, range=0..100)
number_slider_3 = Slider(50, range=0..500)
number_slider_4 = Slider(55, range=0..100)
number_slider_5 = Slider(50, range=0..500)
number_slider_6 = Slider(55, range=0..100)
number_slider_7 = Slider(50, range=0..500)
number_slider_8 = Slider(55, range=0..100)
srf = Surface(<surface referenced from the Rhino model>)
srf_2 = Surface(<surface referenced from the Rhino model>)
srf_3 = Surface(<surface referenced from the Rhino model>)
srf_4 = Surface(<surface referenced from the Rhino model>)
sdivide = DivideSurface(Surface=srf, UCount=number_slider, VCount=number_slider_2)  # -> Points, Normals, Parameters
sdivide_2 = DivideSurface(Surface=srf_2, UCount=number_slider, VCount=number_slider_2)  # -> Points, Normals, Parameters
sdivide_3 = DivideSurface(Surface=srf_3, UCount=number_slider, VCount=number_slider_2)  # -> Points, Normals, Parameters
line = LineSDL(Start=sdivide_3.Points, Direction=sdivide_3.Normals, Length=Slider(9, range=0..10))
sdivide_4 = DivideSurface(Surface=srf_4, UCount=number_slider, VCount=number_slider_2)  # -> Points, Normals, Parameters
line_2 = LineSDL(Start=sdivide_4.Points, Direction=sdivide_4.Normals, Length=Slider(9, range=0..10))
line_3 = LineSDL(Start=sdivide.Points, Direction=sdivide.Normals, Length=Slider(9, range=0..10))
trim = TrimTree(Tree=sdivide.Points, Depth=1)
trim_2 = TrimTree(Tree=sdivide_2.Points, Depth=1)
line_4 = LineSDL(Start=sdivide_2.Points, Direction=sdivide_2.Normals, Length=Slider(9, range=0..10))
trim_3 = TrimTree(Tree=sdivide_3.Points, Depth=1)
trim_4 = TrimTree(Tree=sdivide_4.Points, Depth=1)
panel = Panel(sdivide.Points)
panel_2 = Panel(sdivide.Normals)
panel_3 = Panel(sdivide_2.Normals)
panel_4 = Panel(sdivide_2.Points)
panel_5 = Panel(sdivide_3.Normals)
panel_6 = Panel(sdivide_3.Points)
panel_7 = Panel(sdivide_4.Normals)
panel_8 = Panel(sdivide_4.Points)
graft = GraftTree(Tree=panel, IncludeEmptyLists=True, IncludeNullItems=True)
graft_2 = GraftTree(Tree=panel_2, IncludeEmptyLists=True, IncludeNullItems=True)
txt = Text(",")
graft_3 = GraftTree(Tree=panel_3, IncludeEmptyLists=True, IncludeNullItems=True)
graft_4 = GraftTree(Tree=panel_4, IncludeEmptyLists=True, IncludeNullItems=True)
txt_2 = Text(",")
graft_5 = GraftTree(Tree=panel_5, IncludeEmptyLists=True, IncludeNullItems=True)
graft_6 = GraftTree(Tree=panel_6, IncludeEmptyLists=True, IncludeNullItems=True)
txt_3 = Text(",")
graft_7 = GraftTree(Tree=panel_7, IncludeEmptyLists=True, IncludeNullItems=True)
graft_8 = GraftTree(Tree=panel_8, IncludeEmptyLists=True, IncludeNullItems=True)
txt_4 = Text(",")
join = TextJoin(Text=[graft, graft_2], Join=txt)  # -> flatten(Result)
join_2 = TextJoin(Text=[graft_4, graft_3], Join=txt_2)  # -> flatten(Result)
join_3 = TextJoin(Text=[graft_6, graft_5], Join=txt_3)  # -> flatten(Result)
join_4 = TextJoin(Text=[graft_8, graft_7], Join=txt_4)  # -> flatten(Result)
panel_9 = Panel(join)
panel_10 = Panel(join_2)
panel_11 = Panel(join_3)
panel_12 = Panel(join_4)
dup = DuplicateData(Data="Point", Number=13, Order=True)
# Create Element Names...
panel_13 = Panel("Points")
path_mapper = PathMapper(dup, source="{a;b}(i)", target="{a;b;i}")
launch_visual_studio = BooleanToggle(False)
launch_excel_file = BooleanToggle(False)
excel_live_update = BooleanToggle(True)
txt_5 = Text("pointPos")
dup_2 = DuplicateData(Data=panel_13, Number=13, Order=True)
graft_9 = GraftTree(Tree=panel, IncludeEmptyLists=True, IncludeNullItems=True)
dup_3 = DuplicateData(Data=path_mapper, Number=12, Order=True)
path_mapper_2 = PathMapper(dup_2, source="{a;b}(i)", target="{a;b;i}(0)")
path_mapper_3 = PathMapper(dup_3, source="{a;b;c;d}(i)", target="{a;b;c;i}")
launchapp = LaunchApplication(LaunchToggle=launch_excel_file, ApplicationPath=txt_5)
excelwrite = ExcelWrite(
    WriteToggle=excel_live_update,
    WriteHeading=Toggle(False),
    ClearSheet=Toggle(True),
    Worksheet=1,
    ColumnStart=Slider(1, range=1..5),
    RowStart=Slider(0, range=0..5),
    ColumnHeadings=txt_5,
    Column1=trim)
panel_14 = Panel(excelwrite)
txt_6 = Text("C:\Users\jwarton\Desktop\CSE 8394\of_v0.8.0_vs_release\apps\workspace\rhinoRead\importData.sln")
xml = WriteXML(Data=graft_9, ElementNames=[path_mapper_2, path_mapper_3])
panel_15 = Panel(xml)
launchapp_2 = LaunchApplication(LaunchToggle=launch_visual_studio, ApplicationPath=txt_6)
excelread = ExcelReader(ReadToggle=False, Worksheet=1, Column=1, RowStart=1, RowEnd=10)  # -> Exceptions, ExcelData
