# Grasshopper definition Export.gh (Grasshopper 0.9.64)
# plug-ins: LunchBox

# ORIENT V WITH X
# ORIENT U WITH Y
number_slider = Slider(0.05, range=0..10)
srf = Surface(<surface referenced from the Rhino model>)
number_slider_2 = Slider(25, range=0..500)
number_slider_3 = Slider(20, range=0..100)
int = Integer(1)
sdivide = DivideSurface(Surface=srf, UCount=number_slider_2, VCount=number_slider_3)  # -> Points, Normals, Parameters
addition = Addition(A=number_slider_2, B=int)
addition_2 = Addition(A=number_slider_3, B=int)
series = Series(Start=0, Step=1, Count=10)
line = LineSDL(Start=sdivide.Points, Direction=sdivide.Normals, Length=number_slider)
panel = Panel(addition_2)
panel_2 = Panel(addition)
panel_3 = Panel(sdivide.Normals)
panel_4 = Panel(sdivide.Points)
lng = ListLength(List=sdivide.Points)
concat = Concatenate(FragmentA="/// V:", FragmentB=panel_2)
concat_2 = Concatenate(FragmentA="/// U:", FragmentB=panel)
panel_5 = Panel(concat)
panel_6 = Panel(concat_2)
graft = GraftTree(Tree=panel_4, IncludeEmptyLists=True, IncludeNullItems=True)
graft_2 = GraftTree(Tree=panel_3, IncludeEmptyLists=True, IncludeNullItems=True)
txt = Text(",")
join = TextJoin(Text=[graft, graft_2], Join=txt)  # -> flatten(Result)
concat_3 = Concatenate(FragmentA="/// POS:", FragmentB=join)
merge = Merge(Data1=concat, Data2=concat_2, Data3=concat_3)
panel_7 = Panel(concat_3)
panel_8 = Panel(merge)
trim = TrimTree(Tree=sdivide.Points, Depth=1)
launch_visual_studio = BooleanToggle(False)
launch_excel_file = BooleanToggle(False)
excel_live_update = BooleanToggle(True)
txt_2 = Text("pointPos")
launchapp = LaunchApplication(LaunchToggle=launch_excel_file, ApplicationPath=txt_2)
excelwrite = ExcelWrite(
    WriteToggle=excel_live_update,
    WriteHeading=Toggle(False),
    ClearSheet=Toggle(True),
    Worksheet=1,
    ColumnStart=Slider(1, range=1..5),
    RowStart=Slider(0, range=0..5),
    ColumnHeadings=txt_2,
    Column1=trim)
panel_9 = Panel(excelwrite)
txt_3 = Text("C:\Users\jwarton\Desktop\CSE 8394\of_v0.8.0_vs_release\apps\workspace\rhinoRead\importData.sln")
launchapp_2 = LaunchApplication(LaunchToggle=launch_visual_studio, ApplicationPath=txt_3)
excelread = ExcelReader(ReadToggle=False, Worksheet=1, Column=1, RowStart=1, RowEnd=10)  # -> Exceptions, ExcelData
