# Grasshopper definition Export_spaceframe.gh (Grasshopper 0.9.76)
# plug-ins: Python Interpreter

# ORIENT V WITH X
# ORIENT U WITH Y
number_slider = Slider(0.5, range=0..10)
srf = Surface(<surface referenced from the Rhino model>)
number_slider_2 = Slider(25, range=0..500)
number_slider_3 = Slider(25, range=0..100)
int = Integer(1)
sdivide = DivideSurface(Surface=srf, UCount=number_slider_2, VCount=number_slider_3)  # -> Points, Normals, Parameters
addition = Addition(A=number_slider_2, B=int)
addition_2 = Addition(A=number_slider_3, B=int)
line = LineSDL(Start=sdivide.Points, Direction=sdivide.Normals, Length=number_slider)
panel = Panel(addition_2)
panel_2 = Panel(addition)
panel_3 = Panel(sdivide.Normals)
panel_4 = Panel(sdivide.Points)
lng = ListLength(List=sdivide.Points)
concat = Concatenate(FragmentA="/// V:", FragmentB=panel_2)
concat_2 = Concatenate(FragmentA="/// U:", FragmentB=panel)
panel_5 = Panel(concat)
panel_6 = Panel(concat_2)
graft = GraftTree(Tree=panel_4, IncludeEmptyLists=True, IncludeNullItems=True)
graft_2 = GraftTree(Tree=panel_3, IncludeEmptyLists=True, IncludeNullItems=True)
txt = Text(",")
join = TextJoin(Text=[graft, graft_2], Join=txt)  # -> flatten(Result)
concat_3 = Concatenate(FragmentA="/// POS:", FragmentB=join)
merge = Merge(Data1=concat, Data2=concat_2, Data3=concat_3)
panel_7 = Panel(panel_4)
panel_8 = Panel(concat_3)
panel_9 = Panel(merge)
python = PythonScript(filename="ptPos_01_spaceTruss.txt", content=panel_9)  # -> out, a; inputs content: list
# ---------- python: Python ----------
import os
import sys

path = os.path.dirname(ghenv.LocalScope.ghdoc.Path)
path = os.path.split(path)[0]

url = path + '\\' + filename

with open(url,'w') as out_file:
    for c in content:
        print(c)
        out_file.write(c + "\n")

print(content)
print("File Export Complete")
# ---------- end python ----------
