# Grasshopper definition Export_02.gh (Grasshopper 0.9.64)
# plug-ins: LunchBox

number_slider = Slider(0, range=0..10)
number_slider_2 = Slider(45, range=0..500)
number_slider_3 = Slider(50, range=0..100)
int = Integer(1)
srf = Surface(<surface referenced from the Rhino model>)
srf_2 = Surface(<surface referenced from the Rhino model>)
srf_3 = Surface(<surface referenced from the Rhino model>)
srf_4 = Surface(<surface referenced from the Rhino model>)
addition = Addition(A=number_slider_2, B=int)
addition_2 = Addition(A=number_slider_3, B=int)
sdivide = DivideSurface(Surface=srf, UCount=number_slider_2, VCount=number_slider_3)  # -> Points, Normals, Parameters
sdivide_2 = DivideSurface(Surface=srf_2, UCount=number_slider_2, VCount=number_slider_3)  # -> Points, Normals, Parameters
sdivide_3 = DivideSurface(Surface=srf_3, UCount=number_slider_2, VCount=number_slider_3)  # -> Points, Normals, Parameters
line = LineSDL(Start=sdivide_3.Points, Direction=sdivide_3.Normals, Length=number_slider)
sdivide_4 = DivideSurface(Surface=srf_4, UCount=number_slider_2, VCount=number_slider_3)  # -> Points, Normals, Parameters
line_2 = LineSDL(Start=sdivide_4.Points, Direction=sdivide_4.Normals, Length=number_slider)
line_3 = LineSDL(Start=sdivide.Points, Direction=sdivide.Normals, Length=number_slider)
line_4 = LineSDL(Start=sdivide_2.Points, Direction=sdivide_2.Normals, Length=number_slider)
panel = Panel(addition_2)
panel_2 = Panel(addition)
concat = Concatenate(FragmentA="/// V:", FragmentB=panel_2)
concat_2 = Concatenate(FragmentA="/// U:", FragmentB=panel)
panel_3 = Panel(concat)
panel_4 = Panel(concat_2)
graft = GraftTree(Tree=sdivide.Points, IncludeEmptyLists=True, IncludeNullItems=True)
graft_2 = GraftTree(Tree=sdivide.Normals, IncludeEmptyLists=True, IncludeNullItems=True)
txt = Text(",")
graft_3 = GraftTree(Tree=sdivide_2.Normals, IncludeEmptyLists=True, IncludeNullItems=True)
graft_4 = GraftTree(Tree=sdivide_2.Points, IncludeEmptyLists=True, IncludeNullItems=True)
txt_2 = Text(",")
graft_5 = GraftTree(Tree=sdivide_3.Normals, IncludeEmptyLists=True, IncludeNullItems=True)
graft_6 = GraftTree(Tree=sdivide_3.Points, IncludeEmptyLists=True, IncludeNullItems=True)
txt_3 = Text(",")
graft_7 = GraftTree(Tree=sdivide_4.Normals, IncludeEmptyLists=True, IncludeNullItems=True)
graft_8 = GraftTree(Tree=sdivide_4.Points, IncludeEmptyLists=True, IncludeNullItems=True)
txt_4 = Text(",")
join = TextJoin(Text=[graft, graft_2], Join=txt)  # -> flatten(Result)
join_2 = TextJoin(Text=[graft_4, graft_3], Join=txt_2)  # -> flatten(Result)
join_3 = TextJoin(Text=[graft_6, graft_5], Join=txt_3)  # -> flatten(Result)
join_4 = TextJoin(Text=[graft_8, graft_7], Join=txt_4)  # -> flatten(Result)
concat_3 = Concatenate(FragmentA="/// POS:", FragmentB=join)
concat_4 = Concatenate(FragmentA="/// POS:", FragmentB=join_4)
concat_5 = Concatenate(FragmentA="/// POS:", FragmentB=join_3)
concat_6 = Concatenate(FragmentA="/// POS:", FragmentB=join_2)
merge = Merge(Data1=concat, Data2=concat_2, Data3=concat_3)
merge_2 = Merge(Data1=concat, Data2=concat_2, Data3=concat_6)
merge_3 = Merge(Data1=concat, Data2=concat_2, Data3=concat_5)
merge_4 = Merge(Data1=concat, Data2=concat_2, Data3=concat_4)
trim = TrimTree(Tree=sdivide.Points, Depth=1)
panel_5 = Panel(merge)
panel_6 = Panel(merge_2)
panel_7 = Panel(merge_3)
panel_8 = Panel(merge_4)
launch_visual_studio = BooleanToggle(False)
launch_excel_file = BooleanToggle(False)
excel_live_update = BooleanToggle(True)
txt_5 = Text("pointPos")
launchapp = LaunchApplication(LaunchToggle=launch_excel_file, ApplicationPath=txt_5)
excelwrite = ExcelWrite(
    WriteToggle=excel_live_update,
    WriteHeading=Toggle(False),
    ClearSheet=Toggle(True),
    Worksheet=1,
    ColumnStart=Slider(1, range=1..5),
    RowStart=Slider(0, range=0..5),
    ColumnHeadings=txt_5,
    Column1=trim)
panel_9 = Panel(excelwrite)
txt_6 = Text("C:\Users\jwarton\Desktop\CSE 8394\of_v0.8.0_vs_release\apps\workspace\rhinoRead\importData.sln")
launchapp_2 = LaunchApplication(LaunchToggle=launch_visual_studio, ApplicationPath=txt_6)
excelread = ExcelReader(ReadToggle=False, Worksheet=1, Column=1, RowStart=1, RowEnd=10)  # -> Exceptions, ExcelData
